# Grasshopper definition 160301_Realtime Simulator_Colortizer Parsing.gh (Grasshopper 0.9.76)
# plug-ins: Python Interpreter

panel = Panel("[end]central building height")  # disabled
panel_2 = Panel("[end]random seed number")  # disabled
panel_3 = Panel("[end]input node coordination")  # disabled
# Parsing Colortizer Data (Ryiadh 16x16)
panel_4 = Panel("C:\Users\RYAN\Documents\GitHub\Realtime_Sim\Data\ColortizerData.txt")  # disabled
panel_5 = Panel("[start]central building height")  # disabled
panel_6 = Panel("[start]random seed number")  # disabled
panel_7 = Panel("[start]node reads difference")  # disabled
panel_8 = Panel("[end]node reads difference")  # disabled
panel_9 = Panel("[start]input node coordination")  # disabled
panel_10 = Panel("111")  # disabled
panel_11 = Panel(",")  # disabled

# ---- group: grid size
number_slider = Slider(5, range=1..19)  # disabled
number_slider_2 = Slider(5, range=1..19)  # disabled

# ---- group: grid dimension
# Parametric Modelling
number_slider_3 = Slider(34.331, range=1..100)  # disabled

# ---- group: building dimension
number_slider_4 = Slider(32.578, range=1..100)  # disabled

# ---- group: building heights
number_slider_5 = Slider(0.1, range=0.1..100)  # disabled
number_slider_6 = Slider(50, range=1..100)  # disabled
number_slider_7 = Slider(25, range=1..100)  # disabled
number_slider_8 = Slider(80, range=1..100)  # disabled

# ---- group: heightListID
# 1, 3
number_slider_9 = Slider(1, range=0..3)  # disabled

# ---- group: randam seed for context
# 0, 10, 20, 50
number_slider_10 = Slider(17983, range=0..20000)  # disabled

# ----
# Predict
toggle = BooleanToggle(True)  # disabled
panel_12 = Panel("C:\Users\RYAN\Documents\GitHub\Realtime_Sim\Python\predictWithLR_YZ.py")  # disabled
srf = Surface(<surface referenced from the Rhino model>)  # disabled
panel_13 = Panel("-1")  # disabled
panel_14 = Panel("15")  # disabled

# ---- group: grid size
number_slider_11 = Slider(10.62, range=0..100)  # disabled

# ----
number_slider_12 = Slider(5465, range=0..5465)  # disabled
number_slider_13 = Slider(16, range=0..100)  # disabled
# data1: 0 to 5465
# data2: 1 to 4500
number_slider_14 = Slider(4500, range=1..4500)  # disabled
number_slider_15 = Slider(0, range=0..100)  # disabled
dom = ConstructDomain(DomainStart=panel_13, DomainEnd=panel_14)  # disabled
bbox = BoundingBox(Content=srf, Plane=PlaneXY(0, 0, 0))  # -> Box, Box_2; disabled
neg = Negative(Value=number_slider_11)  # disabled
merge = Merge(Data1=number_slider_5, Data2=number_slider_7, Data3=number_slider_6, Data4=number_slider_8)  # disabled
panel_15 = Panel("int((x+1)/2)")  # disabled
int = Integer(number_slider_9)  # disabled
int_2 = Integer(number_slider_10)  # disabled
int_3 = Integer(int_2)  # disabled
range = Range(Domain=dom, Steps=number_slider_13)  # disabled
txt = Text(flatten(int_3))  # disabled
txt_2 = Text(flatten(panel_10))  # disabled
box_corners = BoxCorners(Box=bbox.Box)  # -> CornerA, CornerB, CornerC, CornerD, CornerE, CornerF, CornerG, CornerH; disabled
timer = Timer(TimerInterval=1000, Target=file)  # disabled
recgrid = Rectangular(Plane=PlaneXY(0, 0, 0), SizeX=number_slider_3, SizeY=number_slider_3, ExtentX=number_slider, ExtentY=number_slider_2)  # -> Cells, Points; disabled
dom_2 = ConstructDomain(DomainStart=number_slider_15, DomainEnd=neg)  # disabled
dom_3 = ConstructDomain(DomainStart=number_slider_15, DomainEnd=number_slider_11)  # disabled
subtraction = Subtraction(A=range, B=0.5)  # disabled

# ---- group: prediction.txt
file = ReadFile(File=panel_4, PerLineParse=True)  # disabled

# ----
item = ListItem(List=merge, Index=int, Wrap=False)  # disabled
num = Number(item)  # disabled
txt_3 = Text(flatten(num))  # disabled

# ---- group: colortizer orgin
pt = Point(box_corners.CornerD)  # disabled

# ----
# temp blocks
xy = XYPlane(Origin=pt)  # disabled
end = EndPoints(Curve=recgrid.Cells)  # -> Start, End; disabled
dom_4 = ConstructDomain(DomainStart=number_slider_15, DomainEnd=subtraction)  # disabled
box = DomainBox(Base=xy, X=dom_3, Y=dom_2, Z=dom_4)  # disabled
split = SplitList(List=file, Index=1)  # -> ListA, ListB; disabled
pshift = ShiftPaths(Data=end.Start, Offset=-1)  # disabled
lng = ListLength(List=pshift)  # disabled
eval = Evaluate(F=panel_15, x=lng)  # disabled
subtraction_2 = Subtraction(A=eval, B=2)  # disabled
panel_16 = Panel("\t")  # disabled
panel_17 = Panel("\t")  # disabled
dom_5 = ConstructDomain(DomainStart=0, DomainEnd=subtraction_2)  # disabled
split_2 = TextSplit(Text=split.ListA, Separators=panel_16)  # disabled
split_3 = TextSplit(Text=split.ListB, Separators=panel_17)  # disabled
subtraction_3 = Subtraction(A=lng, B=1)  # disabled
lng_2 = ListLength(List=merge)  # disabled
addition = Addition(A=subtraction_2, B=1)  # disabled
subset = SubList(List=pshift, Domain=dom_5, Wrap=False)  # -> List, Index; disabled
pshift_2 = ShiftPaths(Data=split_3, Offset=1)  # disabled
pshift_3 = ShiftPaths(Data=split_2, Offset=1)  # disabled
dom_6 = ConstructDomain(DomainStart=eval, DomainEnd=subtraction_3)  # disabled
subtraction_4 = Subtraction(A=lng_2, B=1)  # disabled
item_2 = ListItem(List=pshift, Index=addition, Wrap=True)  # disabled
pshift_4 = ShiftPaths(Data=pshift_2, Offset=1)  # disabled
subset_2 = SubList(List=pshift, Domain=dom_6, Wrap=False)  # -> List, Index; disabled
pshift_5 = ShiftPaths(Data=pshift_3, Offset=1)  # disabled
dom_7 = ConstructDomain(DomainStart=0, DomainEnd=subtraction_4)  # disabled
number_slider_16 = Slider(0.1, range=0.1..100)  # disabled
merge_2 = Merge(Data1=subset.List, Data2=subset_2.List)  # disabled
int_4 = Integer(pshift_4)  # disabled
txt_4 = Text(pshift_5)  # disabled
panel_18 = Panel(txt_4)  # disabled
panel_19 = Panel(int_4)  # disabled
lng_3 = ListLength(List=merge_2)  # disabled
random = Random(Range=Domain(0, 1), Number=lng_3, Seed=int_2)  # disabled
graph = GraphMapper(
    random,
    x0=0,
    x1=1,
    y0=0,
    y1=1,
    container_name="Bezier",
    cpx=[0, 0.5129005909, 1, 1],
    cpy=[0, 0.00346583128, 0.3901748657, 1])  # disabled
remap = RemapNumbers(Value=graph, Source=Domain(0, 1), Target=dom_7)  # -> Mapped, Clipped; disabled
number_slider_17 = Slider(300, range=0..1000)  # disabled

# ---- group: starting pt (except centeral one)
pt_2 = Point(merge_2)  # disabled

# ---- group: centeral starting pt
pt_3 = Point(item_2)  # disabled

# ----
int_5 = Integer(remap.Mapped)  # disabled
xy_2 = XYPlane(Origin=pt_3)  # disabled
xy_3 = XYPlane(Origin=pt_2)  # disabled
dom_8 = ConstructDomain(DomainStart=0, DomainEnd=number_slider_16)  # disabled
item_3 = ListItem(List=merge, Index=int_5, Wrap=True)  # disabled
neg_2 = Negative(Value=number_slider_17)  # disabled
panel_20 = Panel("C:\Users\RYAN\Documents\GitHub\Realtime_Sim\Data\Xtest.txt")  # disabled
dom_9 = ConstructDomain(DomainStart=0, DomainEnd=number_slider_4)  # disabled
dom_10 = ConstructDomain(DomainStart=0, DomainEnd=item_3)  # disabled
dom_11 = ConstructDomain(DomainStart=0, DomainEnd=item)  # disabled
box_2 = DomainBox(Base=xy_2, X=dom_9, Y=dom_9, Z=dom_8)  # disabled
dom_12 = ConstructDomain(DomainStart=neg_2, DomainEnd=number_slider_17)  # disabled
box_3 = DomainBox(Base=xy_3, X=dom_9, Y=dom_9, Z=dom_10)  # disabled
number_slider_18 = Slider(1000, range=0..1000)  # disabled
box_4 = DomainBox(Base=xy_2, X=dom_9, Y=dom_9, Z=dom_11)  # disabled
panel_21 = Panel("0")  # disabled
panel_22 = Panel("3")  # disabled
panel_23 = Panel("1")  # disabled
panel_24 = Panel("2")  # disabled

# ---- group: center blank replacement
brep = Brep(box_2)  # disabled

# ----
toggle_activate = BooleanToggle(True)  # disabled
item_4 = ListItem(List=panel_19, Index=panel_22, Wrap=False)  # disabled
item_5 = ListItem(List=panel_19, Index=panel_21, Wrap=False)  # disabled
item_6 = ListItem(List=panel_19, Index=panel_23, Wrap=False)  # disabled
item_7 = ListItem(List=panel_19, Index=panel_24, Wrap=False)  # disabled
X = UnitX(Factor=number_slider_18)  # disabled

# ---- group: rotation
pshift_6 = ShiftPaths(Data=item_4, Offset=-1)  # disabled

# ---- group: module id
pshift_7 = ShiftPaths(Data=item_5, Offset=-1)  # disabled

# ----
addition_2 = Addition(A=pshift_7, B=1)  # disabled
item_8 = ListItem(List=box, Index=addition_2, Wrap=False)  # disabled

# ---- group: x
pshift_8 = ShiftPaths(Data=item_6, Offset=-1)  # disabled

# ----
multiplication = Multiplication(A=pshift_8, B=number_slider_11)  # disabled
X_2 = UnitX(Factor=multiplication)  # disabled
move = Move(Geometry=item_8, Motion=X_2)  # -> Geometry, Transform; disabled

# ---- group: y
pshift_9 = ShiftPaths(Data=item_7, Offset=-1)  # disabled

# ----
multiplication_2 = Multiplication(A=pshift_9, B=neg)  # disabled
Y = UnitY(Factor=multiplication_2)  # disabled
move_2 = Move(Geometry=move.Geometry, Motion=Y)  # -> Geometry, Transform; disabled
box_5 = Box(move_2.Geometry)  # disabled
panel_25 = Panel(pshift_7)  # disabled
panel_26 = Panel(pshift_6)  # disabled
panel_27 = Panel(pshift_8)  # disabled
panel_28 = Panel(pshift_9)  # disabled
swatch = ColourSwatch(SwatchColor=RGBA(191, 191, 191, 75))  # disabled
swatch_2 = ColourSwatch(SwatchColor=RGBA(171, 190, 255, 150))  # disabled

# ---- group: context geometry
brep_2 = Brep(box_3)  # disabled

# ---- group: center building block geometry
brep_3 = Brep(box_4)  # disabled

# ----
removebreptoporbottom = RemoveBrepTopOrBottom(brep=brep_2, bool=True)  # disabled
preview = CustomPreview(Geometry=removebreptoporbottom, Shader=swatch)  # disabled
removebreptoporbottom_2 = RemoveBrepTopOrBottom(brep=brep_3, bool=True)  # disabled
preview_2 = CustomPreview(Geometry=removebreptoporbottom_2, Shader=swatch_2)  # disabled
number_slider_19 = Slider(1000, range=0..1000)  # disabled
# Parsing Colortizer Data (Barcelona 19x19)
panel_29 = Panel("C:\Users\RYAN\Documents\GitHub\Realtime_Sim\Data\ColortizerData.txt")
neg_3 = Negative(Value=number_slider_19)  # disabled
X_3 = UnitX(Factor=neg_3)  # disabled
X_4 = UnitX(Factor=neg_3)  # disabled
move_3 = Move(Geometry=brep_3, Motion=X_3)  # -> Geometry, Transform; disabled
move_4 = Move(Geometry=brep_2, Motion=X_4)  # -> Geometry, Transform; disabled
srf_2 = Surface(<surface referenced from the Rhino model>)

# ---- group: grid size
number_slider_20 = Slider(10.62, range=0..100)

# ----
number_slider_21 = Slider(0, range=0..100)
preview_3 = CustomPreview(Geometry=move_3.Geometry, Shader=swatch_2)  # disabled
preview_4 = CustomPreview(Geometry=move_4.Geometry, Shader=swatch)  # disabled
dom_13 = ConstructDomain(DomainStart="-1", DomainEnd="23")
addition_3 = Addition(A="23", B=1)
bbox_2 = BoundingBox(Content=srf_2, Plane=PlaneXY(0, 0, 0))  # -> Box, Box_2
neg_4 = Negative(Value=number_slider_20)
range_2 = Range(Domain=dom_13, Steps=addition_3)
box_corners_2 = BoxCorners(Box=bbox_2.Box)  # -> CornerA, CornerB, CornerC, CornerD, CornerE, CornerF, CornerG, CornerH
timer_2 = Timer(TimerInterval=100, Target=file_2)
dom_14 = ConstructDomain(DomainStart=number_slider_21, DomainEnd=neg_4)
dom_15 = ConstructDomain(DomainStart=number_slider_21, DomainEnd=number_slider_20)
subtraction_5 = Subtraction(A=range_2, B=0.5)

# ---- group: prediction.txt
file_2 = ReadFile(File=panel_29, PerLineParse=True)

# ----
number_slider_22 = Slider(1000, range=0..1000)  # disabled

# ---- group: colortizer orgin
pt_4 = Point(box_corners_2.CornerD)

# ----
# temp blocks
xy_4 = XYPlane(Origin=pt_4)
lng_4 = ListLength(List=file_2)
subtraction_6 = Subtraction(A=lng_4, B=1)
dom_16 = ConstructDomain(DomainStart=number_slider_21, DomainEnd=subtraction_5)
box_6 = DomainBox(Base=xy_4, X=dom_15, Y=dom_14, Z=dom_16)
split_4 = SplitList(List=file_2, Index=subtraction_6)  # -> ListA, ListB
X_5 = UnitX(Factor=number_slider_22)  # disabled
X_6 = UnitX(Factor=number_slider_22)  # disabled
split_5 = TextSplit(Text=split_4.ListA, Separators="\t")
split_6 = TextSplit(Text=split_4.ListB, Separators="\t")
move_5 = Move(Geometry=removebreptoporbottom_2, Motion=X_5)  # -> Geometry, Transform; disabled
move_6 = Move(Geometry=removebreptoporbottom, Motion=X_6)  # -> Geometry, Transform; disabled
pshift_10 = ShiftPaths(Data=split_6, Offset=1)
pshift_11 = ShiftPaths(Data=split_5, Offset=1)
preview_5 = CustomPreview(Geometry=move_5.Geometry, Shader=swatch_2)
pshift_12 = ShiftPaths(Data=pshift_10, Offset=1)
preview_6 = CustomPreview(Geometry=move_6.Geometry, Shader=swatch)
pshift_13 = ShiftPaths(Data=pshift_11, Offset=1)
txt_5 = Text(pshift_12)
txt_6 = Text(pshift_13)
panel_30 = Panel(txt_6)
panel_31 = Panel(txt_5)

# ---- group: node base srf
# Nodes
brep_4 = Brep([brep_2, brep_3])  # disabled

# ----
unit_width = Slider(5, range=0..10)  # disabled
unit_height = Slider(5, range=0..10)  # disabled

unit_width_2 = Slider(1.5, range=0..10)  # disabled
unit_height_2 = Slider(4.2, range=0..10)  # disabled

extractbreptoporbottom = ExtractBrepTopOrBottom(brep=brep_4, bool=True)  # disabled
debrep = DeconstructBrep(Brep=brep_4)  # -> Faces, Edges, Vertices; disabled
srf_3 = Surface(reparameterize(flatten(extractbreptoporbottom)))  # disabled
item_9 = ListItem(List=panel_30, Index="3", Wrap=False)
item_10 = ListItem(List=panel_30, Index="0", Wrap=False)
item_11 = ListItem(List=panel_30, Index="1", Wrap=False)
num_2 = Number(unit_width)  # disabled
num_3 = Number(unit_height)  # disabled
item_12 = ListItem(List=panel_30, Index="2", Wrap=False)

# ---- group: glass srf
srf_4 = Surface(reparameterize(graft(srf_3)))  # disabled

# ---- group: rotation
pshift_14 = ShiftPaths(Data=item_9, Offset=-1)

# ---- group: module id
pshift_15 = ShiftPaths(Data=item_10, Offset=-1)

# ----
addition_4 = Addition(A=pshift_15, B=1)
item_13 = ListItem(List=box_6, Index=addition_4, Wrap=False)

# ---- group: x
pshift_16 = ShiftPaths(Data=item_11, Offset=-1)

# ----
multiplication_3 = Multiplication(A=pshift_16, B=number_slider_20)
X_7 = UnitX(Factor=multiplication_3)
move_7 = Move(Geometry=item_13, Motion=X_7)  # -> Geometry, Transform

# ---- group: y
pshift_17 = ShiftPaths(Data=item_12, Offset=-1)

# ----
multiplication_4 = Multiplication(A=pshift_17, B=neg_4)
Y_2 = UnitY(Factor=multiplication_4)
move_8 = Move(Geometry=move_7.Geometry, Motion=Y_2)  # -> Geometry, Transform
box_7 = Box(move_8.Geometry)
dim = Dimensions(Surface=srf_4)  # -> UDimension, VDimension; disabled
panel_32 = Panel(pshift_14)
panel_33 = Panel(pshift_15)
panel_34 = Panel(pshift_16)
panel_35 = Panel(pshift_17)
area = Area(Geometry=srf_3)  # -> Area, Centroid; disabled
division = Division(A=dim.VDimension, B=num_3)  # disabled
division_2 = Division(A=dim.UDimension, B=num_2)  # disabled
divide = DivideDomain²(Domain=srf_4, UCount=division_2, VCount=division)  # disabled
pdecon = Deconstruct(Point=area.Centroid)  # -> XComponent, YComponent, ZComponent; disabled
subsrf = Isotrim(Surface=srf_4, Domain=divide)  # disabled

# ---- group: input building height
num_4 = Number(pdecon.ZComponent)  # disabled

# ---- group: result geo
srf_5 = Surface(reparameterize(flatten(subsrf)))  # disabled

# ----
move_9 = Move(Geometry=srf_5, Motion=X)  # -> Geometry, Transform; disabled
join = BrepJoin(Breps=flatten(brep_4))  # -> Breps, Closed; disabled
area_2 = Area(Geometry=srf_5)  # -> Area, Centroid; disabled
nodes_offset_out = Slider(0.1, range=0..1)  # disabled
mesh = MeshBrep(
    Brep=join.Breps,
    Settings={GridMaxCount=0, GridMinCount=16, JaggedSeams=False, MaxEdgeLength=0, MinEdgeLength=0.0001, MinTolerance=0, Refine=True, RefineAngle=0, RelativeTolerance=0.65, SimplePlanes=True, Tolerance=0})  # disabled
mjoin = MeshJoin(Meshes=mesh)  # disabled
meshcp = MeshClosestPoint(Point=area_2.Centroid, Mesh=mjoin)  # -> Point, Index, Parameter; disabled
meval = MeshEval(Mesh=mjoin, Parameter=meshcp.Parameter)  # -> Point, Normal, Colour; disabled
amp = Amplitude(Vector=meval.Normal, Amplitude=nodes_offset_out)  # disabled
move_10 = Move(Geometry=area_2.Centroid, Motion=amp)  # -> Geometry, Transform; disabled

# ---- group: testing nodes
pt_5 = Point(move_10.Geometry)  # disabled

# Data Export
pt_6 = Point(pt_5)  # disabled

# ----
pdecon_2 = Deconstruct(Point=pt_6)  # -> XComponent, YComponent, ZComponent; disabled
subtraction_7 = Subtraction(A=pdecon_2.ZComponent, B=0.1)  # disabled
merge_3 = Merge(Data1=graft(pdecon_2.XComponent), Data2=graft(pdecon_2.YComponent), Data3=graft(subtraction_7))  # disabled
join_2 = TextJoin(Text=merge_3, Join=panel_11)  # disabled
pshift_18 = ShiftPaths(Data=join_2, Offset=-1)  # disabled
panel_36 = Panel(pshift_18)  # disabled
txt_7 = Text(flatten(panel_36))  # disabled
merge_4 = Merge(
    Data1=panel_5,
    Data2=txt_3,
    Data3=panel,
    Data4=panel_6,
    Data5=txt,
    Data6=panel_2,
    Data7=panel_9,
    Data8=txt_7,
    Data9=panel_3,
    Data10=panel_7,
    Data11=txt_2,
    Data12=panel_8)  # disabled

# ---- group: data to export
panel_37 = Panel(merge_4)  # disabled

# ---- group: write txt file
vb = VBScript(filePath=panel_20, data=panel_37, append=False, activate=toggle_activate)  # -> out, A; inputs data: list; disabled
# ---------- vb: VB ----------
    'Code by Victor Leung @ www.dreamationworks.com
    If activate Then

      Dim i As Integer
      Dim aryText(4) As String

      aryText(0) = "Mary WriteLine"
      aryText(1) = "Had"
      aryText(2) = "Another"
      aryText(3) = "Little"
      aryText(4) = "One"

      ' the data is appended to the file. If file doesnt exist, a new file is created
      Dim objWriter As New System.IO.StreamWriter(filePath, append)

      For i = 0 To data.Count - 1
        objWriter.WriteLine(data(i))
      Next

      objWriter.Close()

    End If

    If clearFile Then
      Dim objWriter As New System.IO.StreamWriter(filePath, False)
      objWriter.Close()
    End If
# ---------- end vb ----------

# ---- group: Call Predict Python Script
python = PythonScript(active=toggle, trigger=vb.A, pathPyPredict=panel_12)  # -> out, predictionPath; disabled
# ---------- python: Python ----------
# -*- coding: utf-8 -*-
"""
Created on Thu Feb 18 00:04:53 2016

@author: RYAN
"""

#str01 = "x:"+str(x)+"; y:"+str(y)+"; z:"+str(z)
#print str01

if active: 
    from subprocess import call
    #call(["python", "C:\\Users\\RYAN\\Documents\\GitHub\\Realtime_Simulator\\Python\\\predictWithLR_YZ.py"])
    #print(pathPyPredict)
    call(["pythonw", pathPyPredict])
    # the print in called python script will not work
    predictionPath = "C:\Users\RYAN\Documents\GitHub\Realtime_Sim\Data\prediction.txt"


"""
call os in gh, and pass input parameters, 
and use subprocess to call a python script with arguement, 
output to a file and have gh read csv. 
"""
# ---------- end python ----------

# ----
panel_38 = Panel(python.predictionPath)  # disabled
# Data File Visualize (difference)
panel_39 = Panel(panel_38)  # disabled

# ---- group: prediction.txt
file_3 = ReadFile(File=panel_39, PerLineParse=True)  # disabled

# ----
split_7 = TextSplit(Text=file_3, Separators=",")  # disabled
num_5 = Number(split_7)  # disabled
panel_40 = Panel(num_5)  # disabled

# ---- group: result difference
num_6 = Number(panel_40)  # disabled

# ----
bnd = Bounds(Numbers=num_6)  # disabled
remap_2 = RemapNumbers(Value=num_6, Source=dom_12, Target=Domain(0, 1))  # -> Mapped, Clipped; disabled
gradient = Gradient(
    LowerLimit=0,
    UpperLimit=1,
    Parameter=remap_2.Mapped,
    stops=[0: RGB(0, 128, 0), 0.5: RGB(255, 255, 0), 1: RGB(255, 0, 0)])  # disabled

# ---- group: result
preview_7 = CustomPreview(Geometry=move_9.Geometry, Shader=gradient)

# ==== cluster RemoveBrepTopOrBottom
brep = ClusterInput()
bool = ClusterInput()
brep_2 = Brep(brep)
bool_2 = Boolean(bool)
num = Number(bool_2)
debrep = DeconstructBrep(Brep=brep_2)  # -> Faces, Edges, Vertices
subtraction = Subtraction(A=num, B=0.5)
multiplication = Multiplication(A=subtraction, B=2)
Z = UnitZ(Factor=multiplication)
area = Area(Geometry=debrep.Faces)  # -> Area, Centroid
srf_cp = SurfaceClosestPoint(Point=area.Centroid, Surface=debrep.Faces)  # -> Point, UVPoint, Distance
evalsrf = EvaluateSurface(Surface=debrep.Faces, Point=srf_cp.UVPoint)  # -> Point, Normal, Frame
angle = Angle(VectorA=evalsrf.Normal, VectorB=Z)  # -> Angle, Reflex
equals = Equality(FirstNumber=angle.Angle, SecondNumber=0)  # -> Equality, Inequality
dispatch = Dispatch(List=debrep.Faces, DispatchPattern=equals.Inequality)  # -> ListA, ListB
srf = Surface(dispatch.ListA)
join = BrepJoin(Breps=srf)  # -> Breps, Closed
pshift = ShiftPaths(Data=join.Breps, Offset=-1)
brep_3 = Brep(pshift)
brep_4 = ClusterOutput(brep_3)

# ==== cluster ExtractBrepTopOrBottom
brep = ClusterInput()
bool = ClusterInput()
brep_2 = Brep(brep)
bool_2 = Boolean(bool)
num = Number(bool_2)
debrep = DeconstructBrep(Brep=brep_2)  # -> Faces, Edges, Vertices
subtraction = Subtraction(A=num, B=0.5)
multiplication = Multiplication(A=subtraction, B=2)
Z = UnitZ(Factor=multiplication)
area = Area(Geometry=debrep.Faces)  # -> Area, Centroid
srf_cp = SurfaceClosestPoint(Point=area.Centroid, Surface=debrep.Faces)  # -> Point, UVPoint, Distance
evalsrf = EvaluateSurface(Surface=debrep.Faces, Point=srf_cp.UVPoint)  # -> Point, Normal, Frame
angle = Angle(VectorA=evalsrf.Normal, VectorB=Z)  # -> Angle, Reflex
equals = Equality(FirstNumber=angle.Angle, SecondNumber=0)  # -> Equality, Inequality
dispatch = Dispatch(List=debrep.Faces, DispatchPattern=equals.Equality)  # -> ListA, ListB
srf = Surface(dispatch.ListA)
srf_2 = ClusterOutput(srf)
